% Simulink data dictionary param.sldd

Tsw = 1.5e-5
step_size = 1.0e-7
fac = 50
Idcmax = 0
duty = tic2000demospkg.Signal(StorageClass="Cla1ToCpuMsgRAM", DataType="uint16")
pid = tic2000demospkg.Signal(StorageClass="Cla1DataRam", DataType="double", InitialValue="0")
ia_pid1 = tic2000demospkg.Signal(StorageClass="Cla1DataRam", DataType="single", InitialValue="0")
ia_pid2 = tic2000demospkg.Signal(StorageClass="Cla1DataRam", DataType="single", InitialValue="0")
ia_pid3 = tic2000demospkg.Signal(StorageClass="Cla1DataRam", DataType="single", InitialValue="0")
ia_pid4 = tic2000demospkg.Signal(StorageClass="Cla1DataRam", DataType="single", InitialValue="0")
ib_pid1 = tic2000demospkg.Signal(StorageClass="Cla1DataRam", DataType="single", InitialValue="0")
ib_pid2 = tic2000demospkg.Signal(StorageClass="Cla1DataRam", DataType="single", InitialValue="0")
ib_pid3 = tic2000demospkg.Signal(StorageClass="Cla1DataRam", DataType="single", InitialValue="0")
ib_pid4 = tic2000demospkg.Signal(StorageClass="Cla1DataRam", DataType="single", InitialValue="0")
ic_pid1 = tic2000demospkg.Signal(StorageClass="Cla1DataRam", DataType="single", InitialValue="0")
ic_pid2 = tic2000demospkg.Signal(StorageClass="Cla1DataRam", DataType="single", InitialValue="0")
ic_pid3 = tic2000demospkg.Signal(StorageClass="Cla1DataRam", DataType="single", InitialValue="0")
ic_pid4 = tic2000demospkg.Signal(StorageClass="Cla1DataRam", DataType="single", InitialValue="0")

adc = Simulink.Bus()
  va: single
  vb: single
  vc: single
  ia: single
  ib: single
  ic: single
  vbulk: single
  vmid: single

adc_rect = Simulink.Bus()
  va: single
  vb: single
  vc: single
  ia: single
  ib: single
  ic: single
  vbulk: single
  vmid: single

vbulk_pid1 = tic2000demospkg.Signal(StorageClass="Cla1DataRam", DataType="single", InitialValue="0")
vbulk_pid2 = tic2000demospkg.Signal(StorageClass="Cla1DataRam", DataType="single", InitialValue="0")
vbulk_pid3 = tic2000demospkg.Signal(StorageClass="Cla1DataRam", DataType="single", InitialValue="0")
vbulk_pid4 = tic2000demospkg.Signal(StorageClass="Cla1DataRam", DataType="single", InitialValue="0")
dcmccm_delay = tic2000demospkg.Signal(StorageClass="Cla1DataRam", DataType="single", InitialValue="0")
vbulk_delay1 = tic2000demospkg.Signal(StorageClass="Cla1DataRam", DataType="single", InitialValue="0")
vbulk_delay2 = tic2000demospkg.Signal(StorageClass="Cla1DataRam", DataType="single", InitialValue="0")
vmid_delay2 = tic2000demospkg.Signal(StorageClass="Cla1DataRam", DataType="single", InitialValue="0")
vmid_delay1 = tic2000demospkg.Signal(StorageClass="Cla1DataRam", DataType="single", InitialValue="0")
vout_pid1 = tic2000demospkg.Signal(StorageClass="Cla1DataRam", DataType="single", InitialValue="0")
vout_pid2 = tic2000demospkg.Signal(StorageClass="Cla1DataRam", DataType="single", InitialValue="0")
Vdc = 750
P = 11000
Vrms = 230
sim_en = 0
Vbulk_Gain = 831.7167
Vdcref = 750