% Simulink data dictionary cllc_data_lib.sldd
% references cllc_data_lib.sldd

adc_digital = Simulink.Bus()
  vbat: uint16
  vout: uint16
  vbulk: uint16
  vaux: uint16
  temp_mux: uint16
  llc1_sec_idc: uint16
  llc1_pri_idc: uint16
  llc2_sec_idc: uint16
  llc2_pri_idc: uint16

epwm2_aqctla_cau = Simulink.Signal(DataType="uint16", InitialValue="1")
epwm2_aqctlb_prd = Simulink.Signal(DataType="uint16", InitialValue="1")
xbar_epwmtrip_llc1_pri_qa_en = Simulink.Signal(DataType="uint16", InitialValue="0")
xbar_epwmtrip_llc1_pri_qb_en = Simulink.Signal(DataType="uint16", InitialValue="0")
xbar_epwmtrip_llc1_pri_qc_en = Simulink.Signal(DataType="uint16", InitialValue="0")
xbar_epwmtrip_llc1_pri_qd_en = Simulink.Signal(DataType="uint16", InitialValue="0")
xbar_epwmtrip_llc2_pri_qa_en = Simulink.Signal(DataType="uint16", InitialValue="0")
xbar_epwmtrip_llc2_pri_qb_en = Simulink.Signal(DataType="uint16", InitialValue="0")
xbar_epwmtrip_llc2_pri_qc_en = Simulink.Signal(DataType="uint16", InitialValue="0")
xbar_epwmtrip_llc2_pri_qd_en = Simulink.Signal(DataType="uint16", InitialValue="0")
xbar_epwmtrip_llc1_sec_qa_en = Simulink.Signal(DataType="uint16", InitialValue="0")
xbar_epwmtrip_llc1_sec_qb_en = Simulink.Signal(DataType="uint16", InitialValue="0")
xbar_epwmtrip_llc1_sec_qc_en = Simulink.Signal(DataType="uint16", InitialValue="0")
xbar_epwmtrip_llc1_sec_qd_en = Simulink.Signal(DataType="uint16", InitialValue="0")
xbar_epwmtrip_llc2_sec_qa_en = Simulink.Signal(DataType="uint16", InitialValue="0")
xbar_epwmtrip_llc2_sec_qb_en = Simulink.Signal(DataType="uint16", InitialValue="0")
xbar_epwmtrip_llc2_sec_qc_en = Simulink.Signal(DataType="uint16", InitialValue="0")
xbar_epwmtrip_llc2_sec_qd_en = Simulink.Signal(DataType="uint16", InitialValue="0")
epwm1_aqcsfrc_csfa = Simulink.Signal(DataType="boolean", InitialValue="1")
epwm1_aqcsfrc_csfb = Simulink.Signal(DataType="boolean", InitialValue="1")
epwm2_aqcsfrc_csfa = Simulink.Signal(DataType="boolean", InitialValue="1")
epwm2_aqcsfrc_csfb = Simulink.Signal(DataType="boolean", InitialValue="1")
epwm4_aqcsfrc_csfa = Simulink.Signal(DataType="boolean", InitialValue="1")
epwm4_aqcsfrc_csfb = Simulink.Signal(DataType="boolean", InitialValue="1")
epwm5_aqcsfrc_csfa = Simulink.Signal(DataType="boolean", InitialValue="1")
epwm5_aqcsfrc_csfb = Simulink.Signal(DataType="boolean", InitialValue="1")
epwm7_aqcsfrc_csfa = Simulink.Signal(DataType="boolean", InitialValue="1")
epwm7_aqcsfrc_csfb = Simulink.Signal(DataType="boolean", InitialValue="1")
epwm8_aqcsfrc_csfa = Simulink.Signal(DataType="boolean", InitialValue="1")
epwm8_aqcsfrc_csfb = Simulink.Signal(DataType="boolean", InitialValue="1")
epwm10_aqcsfrc_csfa = Simulink.Signal(DataType="boolean", InitialValue="1")
epwm10_aqcsfrc_csfb = Simulink.Signal(DataType="boolean", InitialValue="1")
epwm11_aqcsfrc_csfa = Simulink.Signal(DataType="boolean", InitialValue="1")
epwm11_aqcsfrc_csfb = Simulink.Signal(DataType="boolean", InitialValue="1")

signal_cmp = Simulink.Bus()
  llc1_sec_xfmr: single
  llc1_pri_xfmr: single
  llc2_sec_xfmr: single
  llc2_pri_xfmr: single

signal_uart = Simulink.Bus()
  pfc_on: single
  pfc_ready: single

signal_digin = Simulink.Bus()
  can_addr1: boolean
  can_addr2: boolean
  can_addr3: boolean
  can_addr4: boolean
  pfc_ok: boolean
  ac_ok: boolean
  dcdc_en: boolean

signal_digout = Simulink.Bus()
  led_r: boolean
  led_g: boolean
  led_y: boolean
  dsc_cap_io: boolean
  pfc_en: boolean
  temp_mux_s0: boolean
  temp_mux_s1: boolean
  temp_mux_s2: boolean
  valve_en: boolean
  relay_en: boolean

signal_can = Simulink.Bus()
  control_en: boolean
  dir_v2g: boolean
  ref_vbat: uint16
  ref_iout: uint16
  debug_en: boolean
  llc1_ts_tbctr: single
  llc1_ps_tbctr: single
  llc1_burstduty_tbctr: single

llc1_ref_md_zero = Simulink.Signal(DataType="uint16", InitialValue="1")
llc1_ref_md_prd = Simulink.Signal(DataType="uint16", InitialValue="2")
llc2_ref_md_zero = Simulink.Signal(DataType="uint16", InitialValue="1")
llc2_ref_md_prd = Simulink.Signal(DataType="uint16", InitialValue="2")
llc1_ref_cmp_sec = Simulink.Signal(DataType="uint16", InitialValue="1")
llc1_ref_cmp_pri = Simulink.Signal(DataType="uint16", InitialValue="2")
llc2_ref_cmp_sec = Simulink.Signal(DataType="uint16", InitialValue="3")
llc2_ref_cmp_pri = Simulink.Signal(DataType="uint16", InitialValue="4")
epwm5_aqctla_cau = Simulink.Signal(DataType="uint16", InitialValue="1")
epwm5_aqctlb_prd = Simulink.Signal(DataType="uint16", InitialValue="1")

adca_digital = Simulink.Bus()
  vout: uint16
  llc1_sec_idc: uint16
  llc1_pri_idc: uint16

adcb_digital = Simulink.Bus()
  vbulk: uint16
  vaux: uint16
  temp_mux: uint16

signal_adc = Simulink.Bus()
  vout: single
  vbulk: single
  vaux: single
  temp_mux: single
  llc1_sec_idc: single
  llc1_pri_idc: single

v_input = 800
stepsize = 2.0e-7
llc1_ps = tic2000demospkg.Signal(DataType="single", InitialValue="36")
llc1_ts_tbctr = tic2000demospkg.Signal(DataType="single", InitialValue="313")
var_dir_v2g = 0
var_ref_vout = 250
var_ref_iout = 18.5
epwmclk = 100000000
mode = Simulink.Signal(DataType="double")
sim_en = 0
llc1_burstduty = tic2000demospkg.Signal(DataType="single", InitialValue="0")